# Grasshopper definition dennis_sample.gh (Grasshopper 1.0.7)
# plug-ins: Urbano

toggle = BooleanToggle(True)
path = FilePath("C:\Users\Nikhil Saraf\Desktop\Urbano\samples\paris.osm")
featuretype = Building("building")
featuretype_2 = Street("street")
featuretype_3 = Amenity("amenity")
featuretype_4 = Natural("natural")
importosm = ImportOpenStreetMapOSM(OsmFilePath=path, Building=featuretype, Format=0, RunToggle=toggle)  # -> Points, Keys, Values
importosm_2 = ImportOpenStreetMapOSM(OsmFilePath=path, Natural=featuretype_4, Format=0, RunToggle=toggle)  # -> Points, Keys, Values
importosm_3 = ImportOpenStreetMapOSM(OsmFilePath=path, Street=featuretype_2, Format=0, RunToggle=toggle)  # -> Points, Keys, Values
importosm_4 = ImportOpenStreetMapOSM(OsmFilePath=path, Amenity=featuretype_3, Format=0, RunToggle=toggle)  # -> Points, Keys, Values
pline = PolyLine(Vertices=importosm.Points, Closed=False)  # -> flatten(Polyline)
meta = Metadata(FieldNames=importosm_2.Keys, Values=importosm_2.Values)
meta_2 = Metadata(FieldNames=importosm.Keys, Values=importosm.Values)  # -> flatten(Metadata)
meta_3 = Metadata(FieldNames=importosm_4.Keys, Values=importosm_4.Values)  # -> flatten(Metadata)
meta_4 = Metadata(FieldNames=importosm_3.Keys, Values=importosm_3.Values)  # -> flatten(Metadata)
pline_2 = PolyLine(Vertices=importosm_3.Points, Closed=False)  # -> flatten(Polyline)
pt = Point(flatten(importosm_4.Points))
amen = CreateAmenity(Location=pt, Metadata=meta_3)
metacurve = EmbedMetadata(Curve=pline_2, Metadata=meta_4, Key="name")
placeamen = PlaceAmenities(Amenities=amen, Buildings=pline, Tolerance=Slider(5, range=0..10))  # -> Buildings, UnappliedAmenities
toggle_2 = BooleanToggle(True)
bldg = CreateBuilding(Curve=placeamen.Buildings, Metadata=meta_2)
network = Network(
    StreetSegments=metacurve,
    BuildToggle=toggle_2,
    settings="{\"WalkSpeedInKmhr\":5.0,\"WalkSpeed\":83.333333333333329,\"VertexMergeTolerance\":5.0,\"StreetIntersectionTolerance\":2.5,\"ConnectionMaxDistance\":250.0}")  # -> Network, Streets
model = UrbanoModel(Buildings=bldg, Network=network.Network, Amenities=placeamen.UnappliedAmenities, BuildToggle=toggle_2)  # -> UrbanoModel, Activities
item = ListItem(List=bldg, Index=0, Wrap=True)
inbldg = InspectBuilding(UrbanoModel=model.UrbanoModel, Building=item)  # -> Geometry, Metadata, Amenity
lookup = LookupMetadata(Metadata=inbldg.Metadata, Search="height")
Z = UnitZ(Factor=lookup)
extr = Extrude(Base=item, Direction=Z)  # disabled
