# Grasshopper definition features.gh (Grasshopper 1.0.7)
# plug-ins: Urbano

crv = Curve(<curve referenced from the Rhino model>)
crv_2 = Curve(<curve referenced from the Rhino model>)
crv_3 = Curve(<curve referenced from the Rhino model>)
pt = Point([<point referenced from the Rhino model> x6])
pt_2 = Point([<point referenced from the Rhino model> x4])
pt_3 = Point([<point referenced from the Rhino model> x5])
flatten = FlattenTree(Tree=pt, Path="{0}")
merge = Merge(Data1=crv, Data2=crv_2, Data3=crv_3)
flatten_2 = FlattenTree(Tree=pt_2, Path="{1}")
flatten_3 = FlattenTree(Tree=pt_3, Path="{2}")
# Build a street network out of the
# street curves, (creates a routing and
# distance matrix, splits streets at intersections)
pipeline = GeometryPipeline(
    GroupByLayer=False,
    GroupByType=False,
    IncludeHidden=True,
    IncludeLocked=True,
    LayerFilter="streets",
    NameFilter="*",
    SublayerFiltering=True,
    TypeFilter=4)
pipeline_2 = GeometryPipeline(
    GroupByLayer=False,
    GroupByType=False,
    IncludeHidden=True,
    IncludeLocked=True,
    LayerFilter="streets",
    NameFilter="*",
    SublayerFiltering=True,
    TypeFilter=4)
build = BooleanToggle(True)
pipeline_3 = GeometryPipeline(
    GroupByLayer=False,
    GroupByType=False,
    IncludeHidden=True,
    IncludeLocked=True,
    LayerFilter="buildings",
    NameFilter="*",
    SublayerFiltering=True,
    TypeFilter=4)
transnet = TransitNetwork(
    TransitLine=merge,
    Stations=[flatten, flatten_2, flatten_3],
    settings="{\"SpeedInKmHr\":27.0,\"Speed\":450.0,\"LineTransferTime\":3.0,\"StationStopTime\":1.0}")
toggle = BooleanToggle(True)
pipeline_4 = GeometryPipeline(
    GroupByLayer=False,
    GroupByType=False,
    IncludeHidden=True,
    IncludeLocked=True,
    LayerFilter="buildings",
    NameFilter="*",
    SublayerFiltering=True,
    TypeFilter=4)
network = Network(
    StreetSegments=pipeline,
    BuildToggle=build,
    settings="{\"WalkSpeedInKmhr\":5.0,\"WalkSpeed\":83.333333333333329,\"VertexMergeTolerance\":5.0,\"StreetIntersectionTolerance\":2.5,\"ConnectionMaxDistance\":250.0}")  # -> Network, Streets
network_2 = Network(
    StreetSegments=pipeline_2,
    TransitNetworks=transnet,
    BuildToggle=toggle,
    settings="{\"WalkSpeedInKmhr\":5.0,\"WalkSpeed\":83.333333333333329,\"VertexMergeTolerance\":5.0,\"StreetIntersectionTolerance\":2.5,\"ConnectionMaxDistance\":250.0}")  # -> Network, Streets
# Build a model with buildings and the
# street network (population assigned to
# buildings, amenities tabled)
model = UrbanoModel(Buildings=pipeline_3, Network=network.Network, BuildToggle=build)  # -> UrbanoModel, Activities
model_2 = UrbanoModel(Buildings=pipeline_4, Network=network_2.Network, BuildToggle=toggle)  # -> UrbanoModel, Activities
crv_4 = Curve(<curve referenced from the Rhino model>)
crv_5 = Curve(<curve referenced from the Rhino model>)

# ----
# Number of people who used each street
# (Street hits) in these trips
# Number of people who visited each
# amenity (Amenity hits) in these trips
# Persona distribution-weighted
# average walk score
# List of trips is
# branched by persona
# Personas represent the activities
# people need to do within the
# duration of the simulations
# Get the different properties of the trips
# (people, amenity, path, score, cost, etc.)
# Population distribution
# Distribution of specific personas
# (by index) [Should add to 1]
# Ideally, should be run with all buildings input to WalkScore component to get
# an aggregrate walkscore for the entire model (can then weigh the score by the
# population of every building)
# Then use other plugins (like Human) to visualize this data by showing colors
# and extrusions on the 2D geometry (curves for streets,
# footprints for buildings, locations of amenities)
panel = Panel("""restaurant
bank
place_of_worship
bar""")
panel_2 = Panel("""cafe
cafe
school
library
cinema""")
persona = Persona(Activites=simplify(panel_2))
persona_2 = Persona(Activites=panel)
panel_3 = Panel("""0.75
0.25""")
merge_2 = Merge(Data1=persona, Data2=persona_2)
model_3 = UrbanoModel(model.UrbanoModel)
population = Population(Personas=merge_2, Distribution=panel_3)
crv_6 = Curve(<curve referenced from the Rhino model>)
acttrips = ActivityTripEngine(UrbanoModel=model_3, Building=crv_6, Population=population)  # -> Trips, Distribution
walkscore = WalkScore(UrbanoModel=model_3, Trips=acttrips.Trips)
intrip = InspectTrip(Trip=flatten(acttrips.Trips))  # -> Origin, Destination, Path, Cost, Activity, Amenity, People
hits = StreetAmenityHits(UrbanoModel=model_3, ActivityTrips=flatten(acttrips.Trips))  # -> StreetCurves, StreetHits, Amenity, AmenityHits
wav = WeightedAverage(Input=flatten(walkscore), Weights=acttrips.Distribution)
panel_4 = Panel(wav)

router = Router(Network=model_2.UrbanoModel, Origin=crv_4, Destination=crv_5)  # -> Trip, Path, Duration

# ----
# Find all amenities of a certain activity
panel_5 = Panel("bus_stop")

# ----
# Find shortest route between
# any two buildings within the model
crv_7 = Curve(<curve referenced from the Rhino model>)
crv_8 = Curve(<curve referenced from the Rhino model>)

router_2 = Router(Network=model.UrbanoModel, Origin=crv_7, Destination=crv_8)  # -> Trip, Path, Duration
findamen = FindAmenities(UrbanoModel=model.UrbanoModel, Activity=panel_5)
inamen = InspectAmenity(Amenity=findamen)  # -> Name, Activities, Host
panel_6 = Panel(acttrips.Trips)

# ----
# Get the metadata about a
# specific street (by curve), including
# the buildings that connect to it
crv_9 = Curve(<curve referenced from the Rhino model>)

insseg = InspectStreetSegment(UrbanoModel=model.UrbanoModel, Street=crv_9)  # -> Geometry, Metadata, AdjacentBuildings

lookup = LookupMetadata(Metadata=insseg.Metadata, Search="id")

# ----
# Get population (or any other property)
# of every building (or a single building)
# Or find properties about
# specific amenities inside the buildings
pipeline_5 = GeometryPipeline(
    GroupByLayer=False,
    GroupByType=False,
    IncludeHidden=True,
    IncludeLocked=True,
    LayerFilter="buildings",
    NameFilter="*",
    SublayerFiltering=True,
    TypeFilter=4)

inbldg = InspectBuilding(UrbanoModel=model.UrbanoModel, Building=pipeline_5)  # -> Geometry, Metadata, Amenity

lookup_2 = LookupMetadata(Metadata=inbldg.Metadata, Search="population")

inamen_2 = InspectAmenity(Amenity=flatten(inbldg.Amenity))  # -> Name, Activities, Host

# ----
# Find the travel radius for a
# specific building and given time limit
# (15 minutes)
pipeline_6 = GeometryPipeline(
    GroupByLayer=False,
    GroupByType=False,
    IncludeHidden=True,
    IncludeLocked=True,
    LayerFilter="buildings",
    NameFilter="*",
    SublayerFiltering=True,
    TypeFilter=4)
crv_10 = Curve(<curve referenced from the Rhino model>)
time_limit = Slider(16, range=0..100)

router_3 = Router(Network=model.UrbanoModel, Origin=crv_10, Destination=pipeline_6)  # -> TripRoute, Path, Duration

smaller = SmallerThan(FirstNumber=router_3.Duration, SecondNumber=time_limit)  # -> SmallerThan, OrEqualTo
dispatch = Dispatch(List=pipeline_6, DispatchPattern=smaller.OrEqualTo)  # -> ListA, ListB
crv_11 = Curve(dispatch.ListA)
