# Grasshopper definition unnamed.gh (Grasshopper 1.0.7)
# plug-ins: Urbano

panel = Panel("https://github.com/EnvironmentalSystemsLab/Urbano/raw/master/samples/unnamed.gh")
template = UrbanoTemplate(TemplateURLs=panel)
# Download OSM data using bounds
panel_2 = Panel("-73.995")
downloadosm = DownloadOpenStreetMapOSM(LeftBound=panel_2, RightBound="-73.984795", TopBound="40.725097", BottomBound="40.72", RunToggle=Toggle(True))  # -> OSMFilePath, OSMQueryURL, Status
panel_3 = Panel(downloadosm.Status)
path = FilePath("C:\Users\nikhilsaraf\Desktop\Urbano\Examples\examples\buildings_shp\buildings.shp")
importshp = ImportShapefileFeatures(ShapefilePath=path, ReProject=Toggle(True))  # -> Points, Metadata, UTMZone, TranslationVector
osmstreetnet = ImportOSMStreetNetwork(OSMPathOrURL=downloadosm.OSMQueryURL)  # -> StreetNetwork, StreetSegmentCurves, Metadata, UTMZone, TranslationVector
importosm = ImportOSMFeatures(OSMPathOrURL=downloadosm.OSMQueryURL, OSMFeatureType="street", Format=0)  # -> Points, Metadata, UTMZone, TranslationVector
importosm_2 = ImportOSMFeatures(OSMPathOrURL=downloadosm.OSMQueryURL, OSMFeatureType="building", Format=0)  # -> Points, Metadata, UTMZone, TranslationVector
pline = PolyLine(Vertices=importosm.Points, Closed=False)  # -> flatten(Polyline)
pline_2 = PolyLine(Vertices=importosm_2.Points, Closed=False)
streetnet = CreateStreetNetwork(Curves=pline, UTMZone=importosm.UTMZone, TranslationVector=importosm.TranslationVector)  # -> StreetNetwork, StreetSegmentCurves
bldg = CreateBuilding(Curve=pline_2, Metadata=importosm_2.Metadata)  # -> flatten(Building)
model = UrbanoModel(Buildings=bldg, StreetNetwork=osmstreetnet.StreetNetwork, BuildToggle=Toggle(True))  # -> UrbanoModel, Buildings, Activities
